vi "Function_2.gvi"   [LabVIEW NXG 5.1.0]
outputs:
  "Square LED": bool
  "read buffer": string
panel controls:
  "stop": bool
uses:
  NI::VISA::Configure Serial Port (Instr).gvi
  NI::VISA::Read (Instr, String).gvi
  NI::VISA::Close (Instr).gvi
diagram:
  call "Configure Serial Port (Instr).gvi"(session in="COM5", baud rate=9600) -> (session out=w1, error out=w2)
  while {
    Property Node(instance in=w1, error in=w2) -> ("ASRL Bytes at Port"=w3, error out=w4, instance out=w5)
    call "Read (Instr, String).gvi"(session in=w5, error in=w4, byte count=w3) -> (session out=w6, error out=w7, read buffer=w8)
    $"read buffer" <- w8
    String Subset(length (rest)=1, offset (0)=0, string=w8) -> w9
    Is Equal(x=w9, y="a") -> w10
    $"Square LED" <- w10
    Wait(time to wait=250)
    stop if $stop
  }
  call "Close (Instr).gvi"(session in=w6, error in=w7)
