vi "conversions.gvi"   [LabVIEW NXG 5.1.0]
inputs:
  "Numeric": f64
  "Combo Box": string
  "Birim": string
outputs:
  "Metre": string
  "Kilogram,Feet": f64
  "Ton,Metre": f64
  "Pound,Deniz mili": f64
  "Gram,Mile": f64
  "Yard": f64
  "Inch": f64
  "Deniz Mili": string
  "Yard_2": string
  "Inch_2": string
  "Feet": string
  "Mile": string
diagram:
  while {
    case ($Birim) {
      frame "Uzunluk", Default {
        case ($"Combo Box") {
          frame "Metre", Default {
            Multiply($Numeric, 39.37) -> w6
            Multiply($Numeric, 0.00621) -> w3
            Multiply($Numeric, 2.2) -> w4
            Multiply($Numeric, 3.28) -> w2
            Multiply($Numeric, 1) -> w1
            Multiply($Numeric, 1.09) -> w5
          }
          frame "Deniz mili" {
            Multiply($Numeric, 72913) -> w6
            Multiply($Numeric, 1.15) -> w3
            Multiply($Numeric, 1) -> w4
            Multiply($Numeric, 6076.12) -> w2
            # 2.025,37
            Multiply($Numeric, 1852) -> w1
            Multiply($Numeric, 2025) -> w5
          }
          frame "Mile" {
            Multiply($Numeric, 63360) -> w6
            Multiply($Numeric, 1) -> w3
            Multiply($Numeric, 0.87) -> w4
            Multiply($Numeric, 5208) -> w2
            Multiply($Numeric, 1609) -> w1
            Multiply($Numeric, 1760) -> w5
          }
          frame "Yard" {
            Multiply($Numeric, 36) -> w6
            Multiply($Numeric, 0.000568) -> w3
            Multiply($Numeric, 0.000494) -> w4
            Multiply($Numeric, 3) -> w2
            Multiply($Numeric, 0.91) -> w1
            Multiply($Numeric, 1) -> w5
          }
          frame "Inch" {
            Multiply($Numeric, 1) -> w6
            Multiply($Numeric, 1.58e-05) -> w3
            Multiply($Numeric, 1.37e-05) -> w4
            Multiply($Numeric, 0.08) -> w2
            Multiply($Numeric, 0.03) -> w1
            Multiply($Numeric, 0.03) -> w5
          }
          frame "Feet" {
            Multiply($Numeric, 12) -> w6
            Multiply($Numeric, 0.000189) -> w3
            Multiply($Numeric, 0.000165) -> w4
            Multiply($Numeric, 1) -> w2
            Multiply($Numeric, 0.3) -> w1
            Multiply($Numeric, 0.33) -> w5
          }
        }
        w7 = "Mile"
        w8 = "Feet"
        w9 = "Inch"
        w10 = "Yard"
        w11 = "Deniz Mili"
        w12 = "Metre"
      }
      frame "Kutle" {
        case ($"Combo Box") {
          frame "Kilogram", Default {
            Multiply($Numeric, 1000) -> w3
            Multiply($Numeric, 2.2) -> w4
            Multiply($Numeric, 1) -> w2
            Multiply($Numeric, 0.001) -> w1
            w5 = 0
            w6 = 0
          }
          frame "Gram" {
            Multiply($Numeric, 1) -> w3
            Multiply($Numeric, 0.0022) -> w4
            Multiply($Numeric, 0.001) -> w2
            Multiply($Numeric, 1e-06) -> w1
            w5 = 0
            w6 = 0
          }
          frame "Ton" {
            Multiply($Numeric, 1000000) -> w3
            Multiply($Numeric, 2203) -> w4
            Multiply($Numeric, 1000) -> w2
            Multiply($Numeric, 1) -> w1
            w5 = 0
            w6 = 0
          }
          frame "Pound" {
            Multiply($Numeric, 453) -> w3
            Multiply($Numeric, 1) -> w4
            Multiply($Numeric, 0.453) -> w2
            Multiply($Numeric, 0.000453) -> w1
            w5 = 0
            w6 = 0
          }
        }
        w7 = "Gram"
        w8 = "Kilogram"
        w9 = "?"
        w10 = "?"
        w11 = "Pound"
        w12 = "Ton"
      }
    }
    $Inch <- w6
    $"Gram,Mile" <- w3
    $"Pound,Deniz mili" <- w4
    $"Kilogram,Feet" <- w2
    $"Ton,Metre" <- w1
    $Yard <- w5
    $Feet <- w8
    $Metre <- w12
    $"Deniz Mili" <- w11
    $Yard_2 <- w10
    $Inch_2 <- w9
    $Mile <- w7
    Wait(time to wait=150)
    stop if FALSE
  }
