vi "arduino.gvi"   [LabVIEW NXG 5.1.0]
panel controls:
  "session in": "VISA Instr"
uses:
  NI::VISA::Configure Serial Port (Instr).gvi
  NI::VISA::Read (Instr, String).gvi
  WebApp::index.gviweb
  NI::VISA::Write (Instr, String).gvi
  NI::VISA::Close (Instr).gvi
diagram:
  call "Configure Serial Port (Instr).gvi"(session in=$"session in", baud rate=9600) -> (session out=w1, error out=w2)
  while {
    Property Node(instance in=w1, error in=w2) -> ("ASRL Bytes at Port"=w3, error out=w4, instance out=w5)
    call "Read (Instr, String).gvi"(session in=w5, error in=w4, byte count=w3) -> (session out=w6, error out=w7, read buffer=w8)
    String Subset(length (rest)=1, offset (0)=0, string=w8) -> w9
    call "index.gviweb"(y=w9) -> (buton=w10)
    call "Write (Instr, String).gvi"(session in=w5, error in=w4, write buffer=w10) -> (session out=w11, error out=w12)
    stop if FALSE
  }
  call "Close (Instr).gvi"(session in=w11, error in=w12)
  call "Close (Instr).gvi"(session in=w6, error in=w7)
